# Grasshopper definition data_generation.gh (Grasshopper 1.0.7)
# plug-ins: RhinoCodePluginGH

script = Script()  # -> out, a
# ---------- script: Python ----------
import os
import Rhino
import Rhino.Geometry as rg
import Grasshopper

from typing import List

class OBJLoader:
    obj_format = "obj"

    @staticmethod
    def load_obj(path: str, map_y_to_z: bool = False):
        vertices = []
        faces = []

        with open(path, 'r') as file:
            for line in file:
                if line.startswith('v '):
                    parts = line.split()
                    x, y, z = float(parts[1]), float(parts[2]), float(parts[3])

                    if map_y_to_z:
                        vertex = rg.Point3d(x, z, y)
                    else:
                        vertex = rg.Point3d(x, y, z)

                    vertices.append(vertex)

                elif line.startswith('f '):
                    parts = line.split()
                    face_vertices = [int(idx.split('/')[0]) - 1 for idx in parts[1:]]

                    if len(face_vertices) == 3:
                        faces.append(rg.MeshFace(
                            face_vertices[0], 
                            face_vertices[1], 
                            face_vertices[2])
                        )

                    elif len(face_vertices) == 4:
                        faces.append(rg.MeshFace(
                            face_vertices[0], 
                            face_vertices[1], 
                            face_vertices[2], 
                            face_vertices[3])
                        )

        return vertices, faces

    @staticmethod
    def create_mesh(vertices: List[rg.Point3d], faces: List[rg.MeshFace]):
        mesh = rg.Mesh()
        for v in vertices:
            mesh.Vertices.Add(v)

        for f in faces:
            mesh.Faces.AddFace(f)

        mesh.Normals.ComputeNormals()
        mesh.Compact()
        
        return mesh

    @staticmethod
    def centralize_mesh(mesh: rg.Mesh):

        bounding_box = rg.BoundingBox.Empty
        bounding_box.Union(mesh.GetBoundingBox(True))

        center = bounding_box.Center

        translation = rg.Vector3d(-center.X, -center.Y, -center.Z)
        translated_mesh = mesh.Duplicate()
        translated_mesh.Translate(translation)

        return translated_mesh


if __name__ == "__main__":
    a = []

    current_path = os.path.abspath(
        os.path.join(ghenv.Component.OnPingDocument().FilePath, "../")
    )

    obj_path = os.path.join(current_path, OBJLoader.obj_format)
    obj_list = os.listdir(obj_path)
    
    origin = rg.Point3d(0, 0, 0)

    for eoi, each_obj in enumerate(obj_list):
        each_obj_path = os.path.join(obj_path, each_obj)

        vertices, faces = OBJLoader.load_obj(each_obj_path, map_y_to_z=True)
        obj = OBJLoader.create_mesh(vertices, faces)
        obj_centralized = OBJLoader.centralize_mesh(obj)

        arrangement_vector = rg.Vector3d(eoi * 1.5, 0, 0)
        obj_arranged = obj_centralized.Duplicate()
        obj_arranged.Translate(arrangement_vector)
        
        a.append(obj_arranged)
# ---------- end script ----------
geometry = Geometry(script.a)
